% Simulink data dictionary FOC_params.sldd

FOC_PWM_frequency = Simulink.Parameter(10000, StorageClass="ExportedGlobal")
FOC_LUT_NumOfPoints = Simulink.Parameter(1024, StorageClass="ExportedGlobal")
FOC_Control_MTPA_MTPV_w_vec = Simulink.Parameter([0; 10.47198; 20.94395; 31.41593; 41.8879; 52.35988; 62.83185; 73.30383; 83.7758; 94.24778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 1675.516], StorageClass="ExportedGlobal", DataType="double")
FOC_Control_MTPA_MTPV_T_vec = Simulink.Parameter([-245; -240; -235; -230; -225; -220; -215; -210; -205; -200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 245], StorageClass="ExportedGlobal", DataType="double")
FOC_Control_MTPA_MTPV_n_Tmin_grid = Simulink.Parameter([-245.2461; -245.2461; -245.2461; -245.2461; -245.2461; -245.2461; -245.2461; -245.2461; -245.2461; -245.2461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 -103.4213], StorageClass="ExportedGlobal")
FOC_Control_MTPA_MTPV_n_Tmax_grid = Simulink.Parameter([246.1154; 246.1154; 246.1154; 246.1154; 246.1154; 246.1154; 246.1154; 246.1154; 246.1154; 246.1154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 99.56533], StorageClass="ExportedGlobal")

FOC_Control_Current_PILUT_Ld_lut = Simulink.Parameter([6.486917e-05 6.574241e-05 6.686551e-05 6.80728e-05 6.947504e-05 7.130249e-05 7.333498e-05 7.57863e-05 7.927939e-05 8.38381e-05 9.044016e-05 0.0001017324 0.0001209813 0.0001687234 0.0006150453
 6.559501e-05 6.629627e-05 6.722263e-05 6.826785e-05 6.949381e-05 7.107853e-05 7.291877e-05 7.519706e-05 7.839114e-05 8.253872e-05 8.860581e-05 9.882893e-05 0.0001164924 0.0001599535 0.0005674096
 6.639708e-05 6.693517e-05 6.761953e-05 6.843979e-05 6.953281e-05 7.084377e-05 7.240919e-05 7.450427e-05 7.743389e-05 8.096819e-05 8.575014e-05 9.50441e-05 0.0001110929 0.000149422 0.0005061088
 6.712815e-05 6.756848e-05 6.807537e-05 6.857117e-05 6.939905e-05 7.078529e-05 7.225755e-05 7.375057e-05 7.588258e-05 7.897926e-05 8.364107e-05 9.180229e-05 0.0001056168 0.0001388731 0.0004499217
 6.790599e-05 6.827251e-05 6.872098e-05 6.894933e-05 6.945451e-05 7.092638e-05 7.213088e-05 7.292878e-05 7.453447e-05 7.747156e-05 8.156102e-05 8.845091e-05 0.0001000123 0.0001277895 0.0003903845
 6.8611e-05 6.893687e-05 6.927747e-05 6.950708e-05 6.997652e-05 7.125098e-05 7.201022e-05 7.270815e-05 7.432132e-05 7.699128e-05 7.95157e-05 8.516918e-05 9.518911e-05 0.0001177141 0.0003326537
 6.934289e-05 6.970505e-05 7.007501e-05 7.049995e-05 7.091866e-05 7.131316e-05 7.227759e-05 7.32263e-05 7.4603e-05 7.632229e-05 7.776959e-05 8.203302e-05 8.994232e-05 0.000107192 0.0002708219
 7.023305e-05 7.079705e-05 7.12443e-05 7.166456e-05 7.189273e-05 7.193159e-05 7.268157e-05 7.368807e-05 7.450046e-05 7.527916e-05 7.718803e-05 7.959171e-05 8.414625e-05 9.771198e-05 0.0002130024
 7.113328e-05 7.189498e-05 7.210667e-05 7.244556e-05 7.294081e-05 7.314001e-05 7.366949e-05 7.440245e-05 7.492006e-05 7.542122e-05 7.702626e-05 7.862497e-05 8.104681e-05 8.950335e-05 0.0001658578
 7.234845e-05 7.322815e-05 7.316383e-05 7.360421e-05 7.440558e-05 7.482011e-05 7.519683e-05 7.551629e-05 7.595241e-05 7.664099e-05 7.736122e-05 7.860164e-05 8.017008e-05 8.332646e-05 0.0001245628
 7.390047e-05 7.432776e-05 7.475101e-05 7.51655e-05 7.568351e-05 7.607839e-05 7.644173e-05 7.649516e-05 7.685967e-05 7.793966e-05 7.859438e-05 7.912346e-05 8.015967e-05 8.303929e-05 0.0001027296
 7.485727e-05 7.505955e-05 7.576747e-05 7.601094e-05 7.615293e-05 7.709371e-05 7.746689e-05 7.786363e-05 7.875325e-05 7.960049e-05 7.979526e-05 8.050766e-05 8.15916e-05 8.267525e-05 9.505887e-05
 7.530236e-05 7.580593e-05 7.649791e-05 7.678098e-05 7.711704e-05 7.807603e-05 7.851177e-05 7.931594e-05 8.025392e-05 8.045328e-05 8.145654e-05 8.332497e-05 8.487328e-05 8.683449e-05 0.000105895
 7.565015e-05 7.642077e-05 7.69863e-05 7.746776e-05 7.802655e-05 7.867033e-05 7.918695e-05 7.984348e-05 8.046829e-05 8.087738e-05 8.321319e-05 8.520368e-05 8.717926e-05 9.200919e-05 0.0001223472
 7.613223e-05 7.659726e-05 7.715132e-05 7.766498e-05 7.809406e-05 7.854943e-05 7.964118e-05 7.97882e-05 7.991712e-05 8.235541e-05 8.400642e-05 8.482875e-05 8.674126e-05 9.45612e-05 0.0001259852
 7.595858e-05 7.641253e-05 7.700258e-05 7.75429e-05 7.804271e-05 7.870854e-05 7.941843e-05 7.993024e-05 8.044177e-05 8.124619e-05 8.326181e-05 8.433789e-05 8.627878e-05 9.355104e-05 0.0001227982
 7.524747e-05 7.594237e-05 7.657e-05 7.708939e-05 7.765792e-05 7.81884e-05 7.877649e-05 7.939567e-05 8.005663e-05 8.089745e-05 8.231112e-05 8.377926e-05 8.503163e-05 8.781146e-05 0.0001097266
 7.429241e-05 7.50771e-05 7.571867e-05 7.618817e-05 7.666126e-05 7.71275e-05 7.778704e-05 7.83077e-05 7.870438e-05 7.964546e-05 8.070381e-05 8.245732e-05 8.328648e-05 8.280459e-05 9.964032e-05
 7.365102e-05 7.393009e-05 7.467552e-05 7.510723e-05 7.541437e-05 7.619861e-05 7.675361e-05 7.736329e-05 7.75834e-05 7.675073e-05 7.850152e-05 8.049734e-05 8.205804e-05 8.553421e-05 0.0001051771
 7.267665e-05 7.298499e-05 7.328122e-05 7.374306e-05 7.4314e-05 7.482977e-05 7.538408e-05 7.584752e-05 7.624252e-05 7.685179e-05 7.670559e-05 7.85502e-05 8.224177e-05 8.747604e-05 0.0001359553
 7.172421e-05 7.19182e-05 7.224223e-05 7.26649e-05 7.316554e-05 7.37139e-05 7.418858e-05 7.468826e-05 7.555487e-05 7.655093e-05 7.709155e-05 7.827706e-05 8.196105e-05 9.153951e-05 0.0001669605
 7.075299e-05 7.079568e-05 7.096034e-05 7.138081e-05 7.201791e-05 7.27171e-05 7.329062e-05 7.387425e-05 7.493688e-05 7.6372e-05 7.787116e-05 7.955011e-05 8.414963e-05 9.830666e-05 0.0002064719
 6.968307e-05 6.965821e-05 6.943061e-05 6.996426e-05 7.106599e-05 7.176557e-05 7.260775e-05 7.332826e-05 7.442585e-05 7.67064e-05 7.83031e-05 8.211498e-05 8.996222e-05 0.0001078248 0.0002622633
 6.868832e-05 6.872442e-05 6.892151e-05 6.94928e-05 7.037595e-05 7.125992e-05 7.206976e-05 7.330188e-05 7.494461e-05 7.629126e-05 7.948993e-05 8.521897e-05 9.465466e-05 0.0001167292 0.000316206
 6.768302e-05 6.797444e-05 6.847033e-05 6.909297e-05 6.978158e-05 7.053057e-05 7.186065e-05 7.350169e-05 7.537951e-05 7.77387e-05 8.143815e-05 8.861011e-05 0.0001003708 0.0001270645 0.0003750913
 6.685952e-05 6.736008e-05 6.803793e-05 6.878081e-05 6.954032e-05 7.029506e-05 7.183737e-05 7.378134e-05 7.60208e-05 7.920579e-05 8.364174e-05 9.119426e-05 0.0001042757 0.0001364735 0.0004326936
 6.608853e-05 6.674451e-05 6.757395e-05 6.844238e-05 6.940894e-05 7.032876e-05 7.195962e-05 7.417367e-05 7.69312e-05 8.018623e-05 8.540826e-05 9.294959e-05 0.0001067039 0.0001456463 0.0004871503
 6.527746e-05 6.605611e-05 6.701972e-05 6.801049e-05 6.909224e-05 7.049349e-05 7.223348e-05 7.454604e-05 7.78077e-05 8.181049e-05 8.63771e-05 9.481077e-05 0.0001112994 0.0001543736 0.0005395687
 6.454582e-05 6.541015e-05 6.648037e-05 6.759037e-05 6.886735e-05 7.055744e-05 7.24774e-05 7.490801e-05 7.844464e-05 8.273425e-05 8.871135e-05 9.858115e-05 0.0001167223 0.0001634075 0.0005920948
 6.375068e-05 6.469737e-05 6.588022e-05 6.71469e-05 6.864558e-05 7.058871e-05 7.270939e-05 7.529458e-05 7.90095e-05 8.414817e-05 9.1828e-05 0.0001022362 0.000119669 0.0001711855 0.000633968], StorageClass="ExportedGlobal", DataType="double")

FOC_Control_Current_PILUT_Lq_lut = Simulink.Parameter([0.0001464363 0.0001440893 0.0001416195 0.0001395121 0.0001376369 0.0001359424 0.0001347682 0.000133978 0.0001334295 0.0001329925 0.0001324913 0.000131903 0.0001312749 0.0001305546 0.0001298134
 0.0001505997 0.0001485024 0.0001463194 0.0001445036 0.0001429592 0.0001416994 0.0001409529 0.000140538 0.0001402598 0.0001398868 0.0001393484 0.0001386542 0.000137935 0.0001371373 0.0001361571
 0.0001558184 0.0001540793 0.0001522779 0.0001508538 0.0001497821 0.000149163 0.0001490443 0.0001489578 0.0001487109 0.0001482461 0.0001475955 0.0001469254 0.0001461841 0.0001452337 0.0001441014
 0.0001612748 0.0001600077 0.000158689 0.0001576997 0.0001573012 0.0001576016 0.0001577476 0.0001575517 0.0001571098 0.0001566467 0.0001561476 0.0001554094 0.0001545565 0.0001535597 0.0001522805
 0.000167975 0.0001674507 0.0001669296 0.0001666985 0.0001670918 0.0001679653 0.0001681627 0.0001678378 0.0001673817 0.0001670584 0.0001666489 0.0001658864 0.0001649412 0.000163811 0.0001623465
 0.0001747673 0.0001751478 0.0001756578 0.0001763256 0.0001771823 0.0001780425 0.0001784354 0.0001783817 0.0001782026 0.0001780216 0.0001773995 0.0001766959 0.0001757907 0.0001744451 0.0001728233
 0.0001820974 0.0001835228 0.0001851446 0.0001865953 0.0001877538 0.0001886971 0.0001896752 0.0001900642 0.0001901537 0.0001901136 0.0001893002 0.0001885919 0.0001877378 0.0001863448 0.0001846992
 0.0001904896 0.0001930866 0.0001956308 0.0001977308 0.0001993293 0.0002005916 0.0002020563 0.0002032633 0.0002037862 0.000203741 0.0002037299 0.0002028608 0.0002019386 0.0002011906 0.000199423
 0.0001981139 0.000201541 0.000204409 0.000207046 0.0002095494 0.0002116179 0.0002135733 0.0002153876 0.0002165529 0.0002170069 0.0002175758 0.0002171816 0.0002164051 0.0002157749 0.0002143822
 0.0002058381 0.0002098619 0.000212875 0.0002162016 0.0002197664 0.0002229774 0.0002254985 0.0002276113 0.0002296745 0.000231382 0.0002324625 0.0002332927 0.0002332579 0.0002324684 0.0002319214
 0.0002121308 0.000215988 0.0002201366 0.0002237318 0.000227393 0.0002311445 0.0002342 0.0002365524 0.0002393291 0.0002424353 0.0002447462 0.0002465765 0.0002477539 0.0002484214 0.0002482377
 0.0002158963 0.0002198467 0.0002248137 0.0002282267 0.0002315294 0.0002365876 0.0002401621 0.000243316 0.0002471398 0.0002506317 0.0002533154 0.0002564064 0.0002591285 0.0002612193 0.000262837
 0.0002153491 0.0002201497 0.0002256571 0.00022932 0.0002330192 0.0002386435 0.0002427562 0.000246885 0.0002512975 0.0002546244 0.0002581548 0.0002626078 0.0002666226 0.000270363 0.0002742518
 0.0002046101 0.0002112537 0.0002176205 0.0002230214 0.0002283784 0.0002335606 0.0002380592 0.0002432682 0.0002482616 0.0002518057 0.0002579466 0.0002635335 0.0002685685 0.0002744364 0.0002803092
 0.0002594974 0.0002624391 0.0002642649 0.0002660567 0.0002677085 0.0002685571 0.000269803 0.0002708894 0.0002713865 0.0002714839 0.0002729027 0.0002742079 0.0002757352 0.0002786174 0.0002802461
 0.0002594974 0.0002624391 0.0002642649 0.0002660567 0.0002677085 0.0002685571 0.000269803 0.0002708894 0.0002713865 0.0002714839 0.0002729027 0.0002742079 0.0002757352 0.0002786174 0.0002802461
 0.0002429526 0.0002464118 0.0002492543 0.0002519165 0.0002544983 0.0002566378 0.0002588521 0.0002608153 0.0002630375 0.0002655032 0.0002674104 0.0002694959 0.000271211 0.0002728607 0.0002750839
 0.0002331269 0.0002363396 0.0002396196 0.000242543 0.0002452808 0.0002479772 0.0002505805 0.0002529476 0.0002551261 0.0002574082 0.0002596388 0.0002621182 0.0002632306 0.0002632784 0.0002641342
 0.0002247989 0.0002275886 0.0002310366 0.000233957 0.0002366241 0.0002395281 0.0002418655 0.0002443009 0.0002461869 0.0002466324 0.0002490498 0.0002508181 0.0002514201 0.0002515163 0.0002501081
 0.0002157228 0.0002184461 0.0002210934 0.0002237399 0.0002263511 0.0002285939 0.0002305477 0.0002322279 0.0002335966 0.0002345344 0.0002344529 0.0002349966 0.0002353156 0.0002344056 0.0002327546
 0.000206673 0.0002090723 0.0002115012 0.0002136031 0.0002155324 0.0002173777 0.0002188018 0.0002198374 0.0002207073 0.0002211271 0.0002206329 0.0002198606 0.0002192992 0.0002183761 0.0002163923
 0.0001973644 0.0001991025 0.0002010236 0.000202712 0.0002041871 0.0002055186 0.0002064168 0.0002069219 0.000207225 0.0002072298 0.0002066117 0.0002053779 0.0002043365 0.0002032912 0.0002010945
 0.0001875449 0.0001883358 0.0001892614 0.0001905788 0.0001919017 0.0001925311 0.0001929622 0.0001930808 0.0001929351 0.0001927436 0.0001917643 0.0001907711 0.0001898443 0.0001883825 0.0001862639
 0.0001791929 0.0001791368 0.0001793341 0.0001799552 0.0001807808 0.0001811855 0.0001812977 0.0001813239 0.0001810407 0.0001802475 0.0001795515 0.0001786271 0.0001775621 0.0001762202 0.0001742247
 0.0001710079 0.0001701983 0.0001694293 0.0001691502 0.0001694147 0.0001696344 0.0001696978 0.0001695688 0.0001690933 0.0001684353 0.0001676499 0.0001667521 0.0001657177 0.0001643608 0.0001626731
 0.0001643839 0.0001630343 0.0001616822 0.0001607339 0.0001601234 0.0001598672 0.0001599231 0.0001597568 0.0001592151 0.000158674 0.0001579532 0.0001569794 0.0001559596 0.0001548161 0.0001534116
 0.000158557 0.0001568031 0.0001549904 0.0001534845 0.0001521914 0.0001512443 0.0001510728 0.0001508567 0.0001503722 0.0001497981 0.0001491997 0.0001481314 0.0001471426 0.0001464064 0.0001451398
 0.0001530288 0.0001509163 0.0001486774 0.0001467451 0.0001450375 0.0001436119 0.000142741 0.0001421894 0.0001418166 0.0001413778 0.0001405337 0.0001395747 0.0001388363 0.0001381721 0.0001370525
 0.0001486265 0.0001462327 0.000143683 0.0001414752 0.0001394894 0.0001376695 0.0001363645 0.0001354598 0.0001348269 0.0001342775 0.0001336838 0.0001328716 0.0001321658 0.0001315015 0.0001305863
 0.0001444475 0.0001417897 0.0001389631 0.0001365089 0.0001342474 0.0001320738 0.0001304337 0.0001291542 0.0001281314 0.0001275606 0.0001271783 0.0001263302 0.0001254401 0.0001248776 0.0001236475], StorageClass="ExportedGlobal", DataType="double")

FOC_Control_Current_PILUT_id_bp = Simulink.Parameter([-661.3622; -616.4549; -567.4651; -522.5578; -477.6505; -428.6607; -383.7534; -338.8461; -289.8563; -244.949; -200.0417; -151.0519; -106.1446; -61.23724; -12.24745], StorageClass="ExportedGlobal", DataType="double")
FOC_Control_Current_PILUT_iq_bp = Simulink.Parameter([-653.1973; -608.29; -559.3002; -514.3928; -465.4031; -420.4957; -375.5884; -326.5986; -281.6913; -232.7015; -187.7942; -142.8869; -93.89711; -48.98979; 0; 44.90731; 89.81462; 138.8044; 183.7117; 232.7015; 277.6088; 322.5161; 371.5059; 416.4133; 465.4031; 510.3104; 555.2177; 604.2075; 649.1148; 698.1046], StorageClass="ExportedGlobal", DataType="double")
FOC_Control_Current_TclCur = Simulink.Parameter(0.1, StorageClass="ExportedGlobal", DataType="double")
FOC_Control_Current_KPiq = Simulink.Parameter(0.5867463, StorageClass="ExportedGlobal", DataType="double")
FOC_Control_Current_KIiq = Simulink.Parameter(10, StorageClass="ExportedGlobal", DataType="double")
FOC_Control_Current_KPid = Simulink.Parameter(0.2041851, StorageClass="ExportedGlobal", DataType="double")
FOC_Control_Current_KIid = Simulink.Parameter(10, StorageClass="ExportedGlobal", DataType="double")
FOC_Control_Current_Krq = Simulink.Parameter(0.8, StorageClass="ExportedGlobal", DataType="double")
FOC_Control_Current_Tnq = Simulink.Parameter(0.1, StorageClass="ExportedGlobal", DataType="double")
FOC_Control_Current_Krd = Simulink.Parameter(0.8, StorageClass="ExportedGlobal", DataType="double")
FOC_Control_Current_Tnd = Simulink.Parameter(0.1, StorageClass="ExportedGlobal", DataType="double")
FOC_Control_Speed_PhiR = Simulink.Parameter(1.047198, StorageClass="ExportedGlobal", DataType="double")
FOC_Control_Speed_alpha = Simulink.Parameter(3.732051, StorageClass="ExportedGlobal", DataType="double")
FOC_Control_Speed_Te = Simulink.Parameter(0.101, StorageClass="ExportedGlobal", DataType="double")
FOC_Control_Speed_Tns = Simulink.Parameter(1.406749, StorageClass="ExportedGlobal", DataType="double")
FOC_Control_Speed_KPs = Simulink.Parameter(0.424474, StorageClass="ExportedGlobal", DataType="double")
FOC_Control_Speed_KIs = Simulink.Parameter(0.3017412, StorageClass="ExportedGlobal", DataType="double")
FOC_SampleTime_TsSpeed = Simulink.Parameter(0.001, StorageClass="ExportedGlobal", DataType="double")
FOC_Control_OpenLoop_Uq_OpenLoop_V = Simulink.Parameter(0, StorageClass="ExportedGlobal", DataType="double")
FOC_Control_OpenLoop_Ud_OpenLoop_V = Simulink.Parameter(0, StorageClass="ExportedGlobal", DataType="double")
FOC_Control_OpenLoop_Iq_Ref_A = Simulink.Parameter(0, StorageClass="ExportedGlobal", DataType="double")
FOC_Control_OpenLoop_Id_Ref_A = Simulink.Parameter(0, StorageClass="ExportedGlobal", DataType="double")
FOC_Control_TorqueRef_Nm = Simulink.Parameter(10, StorageClass="ExportedGlobal", DataType="double")
FOC_Control_SpeedRef_rpm = Simulink.Parameter(9000, StorageClass="ExportedGlobal", DataType="double")
FOC_Control_RF_RateTrq_Nm = Simulink.Parameter(500, StorageClass="ExportedGlobal", DataType="double")
FOC_Control_RF_RateSpeed_rpm = Simulink.Parameter(2000, StorageClass="ExportedGlobal", DataType="double")
FOC_Control_RF_RateCurrent_A = Simulink.Parameter(500, StorageClass="ExportedGlobal", DataType="double")
FOC_Control_InverterVdc_V = Simulink.Parameter(400, StorageClass="ExportedGlobal", DataType="double")
FOC_Control_MotorImax_A = Simulink.Parameter(650, StorageClass="ExportedGlobal", DataType="double")
FOC_Control_Umax_V = Simulink.Parameter(230.9401, StorageClass="ExportedGlobal", DataType="double")
FOC_Control_U_fb = Simulink.Parameter(230.9401, StorageClass="ExportedGlobal", DataType="double")

FOC_Control_MTPA_MTPV_nT_id_grid = Simulink.Parameter([-450.067 -450.067 -450.067 -450.067 -450.067 -450.067 -450.067 -450.0671 -450.0671 -450.0671 -450.0671 -450.067 -450.0671 -450.067 -450.067 -450.067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
 -439.5618 -439.5618 -439.5618 -439.5618 -439.5618 -439.5618 -439.5618 -439.5618 -439.5618 -439.5618 -439.5618 -439.5618 -439.5618 -439.5618 -439.5618 -439.5618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
 -427.7778 -427.7778 -427.7778 -427.7778 -427.7778 -427.7778 -427.7778 -427.7778 -427.7779 -427.7778 -427.7778 -427.7779 -427.7778 -427.7778 -427.7778 -427.7778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
 -416.664 -416.664 -416.664 -416.664 -416.664 -416.664 -416.664 -416.664 -416.664 -416.664 -416.664 -416.664 -416.664 -416.664 -416.664 -416.664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
 -406.0755 -406.0755 -406.0755 -406.0755 -406.0755 -406.0755 -406.0755 -406.0755 -406.0755 -406.0755 -406.0755 -406.0755 -406.0755 -406.0755 -406.0755 -406.0755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
 -395.1552 -395.1552 -395.1552 -395.1552 -395.1552 -395.1552 -395.1552 -395.1552 -395.1552 -395.1552 -395.1552 -395.1552 -395.1552 -395.1552 -395.1552 -395.1552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
 -384.3118 -384.3118 -384.3118 -384.3118 -384.3118 -384.3118 -384.3118 -384.3118 -384.3118 -384.3118 -384.3118 -384.3118 -384.3118 -384.3118 -384.3118 -384.3118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
 -374.0365 -374.0365 -374.0365 -374.0365 -374.0365 -374.0365 -374.0365 -374.0365 -374.0365 -374.0365 -374.0365 -374.0365 -374.0365 -374.0365 -374.0365 -374.0365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
 -363.9055 -363.9055 -363.9055 -363.9055 -363.9055 -363.9055 -363.9055 -363.9055 -363.9055 -363.9055 -363.9055 -363.9055 -363.9055 -363.9055 -363.9055 -363.9055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
 -353.7948 -353.7948 -353.7948 -353.7948 -353.7948 -353.7948 -353.7948 -353.7948 -353.7948 -353.7948 -353.7948 -353.7948 -353.7948 -353.7948 -353.7948 -353.7948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 ], StorageClass="ExportedGlobal", DataType="double")

FOC_Control_MTPA_MTPV_nT_iq_grid = Simulink.Parameter([-449.0917 -449.0917 -449.0917 -449.0917 -449.0917 -449.0917 -449.0917 -449.0917 -449.0916 -449.0917 -449.0917 -449.0917 -449.0917 -449.0917 -449.0917 -449.0917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
 -442.5696 -442.5696 -442.5696 -442.5696 -442.5696 -442.5696 -442.5696 -442.5696 -442.5696 -442.5696 -442.5696 -442.5696 -442.5696 -442.5696 -442.5696 -442.5696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
 -437.2525 -437.2525 -437.2525 -437.2525 -437.2525 -437.2525 -437.2525 -437.2525 -437.2525 -437.2525 -437.2525 -437.2525 -437.2525 -437.2525 -437.2525 -437.2525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
 -430.9179 -430.9179 -430.9179 -430.9179 -430.9179 -430.9179 -430.9179 -430.9179 -430.9179 -430.9179 -430.9179 -430.9179 -430.9179 -430.9179 -430.9179 -430.9179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
 -423.8374 -423.8374 -423.8374 -423.8374 -423.8374 -423.8374 -423.8374 -423.8374 -423.8374 -423.8374 -423.8374 -423.8374 -423.8374 -423.8374 -423.8374 -423.8374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
 -417.1173 -417.1173 -417.1173 -417.1173 -417.1173 -417.1173 -417.1173 -417.1173 -417.1173 -417.1173 -417.1173 -417.1173 -417.1173 -417.1173 -417.1173 -417.1173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
 -410.5406 -410.5406 -410.5406 -410.5407 -410.5406 -410.5407 -410.5406 -410.5406 -410.5406 -410.5407 -410.5406 -410.5407 -410.5406 -410.5406 -410.5407 -410.5406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
 -403.7158 -403.7158 -403.7158 -403.7158 -403.7158 -403.7158 -403.7158 -403.7158 -403.7158 -403.7158 -403.7158 -403.7158 -403.7158 -403.7158 -403.7158 -403.7158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
 -396.9361 -396.9361 -396.9361 -396.9361 -396.9361 -396.9361 -396.9361 -396.9361 -396.9361 -396.9361 -396.9361 -396.9361 -396.9361 -396.9361 -396.9361 -396.9361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
 -390.1579 -390.1579 -390.1579 -390.1579 -390.1579 -390.1579 -390.1579 -390.1579 -390.1579 -390.1579 -390.1579 -390.1579 -390.1579 -390.1579 -390.1579 -390.1579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 ], StorageClass="ExportedGlobal", DataType="double")

FOC_Flag_ClosedLoopControl = Simulink.Parameter(1, StorageClass="ExportedGlobal", DataType="boolean")
FOC_Flag_TorqueControl = Simulink.Parameter(1, StorageClass="ExportedGlobal", DataType="boolean")
FOC_Flag_PWMEnable = Simulink.Parameter(1, StorageClass="ExportedGlobal", DataType="boolean")
FOC_Flag_ResetControl = Simulink.Parameter(0, StorageClass="ExportedGlobal", DataType="boolean")
FOC_Flag_ControlStrategy = Simulink.Parameter(2, StorageClass="ExportedGlobal", DataType="uint8")
FOC_LUT_ParkClake_theta_Vec = Simulink.Parameter([0 0.006141921 0.01228384 0.01842576 0.02456768 0.03070961 0.03685153 0.04299345 0.04913537 0.05527729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 6.283185], StorageClass="ExportedGlobal", DataType="double")
FOC_LUT_ParkClake_SinLut = Simulink.Parameter([0 0.006141883 0.01228353 0.01842472 0.02456521 0.03070478 0.03684319 0.0429802 0.0491156 0.05524914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 -2.449294e-16], StorageClass="ExportedGlobal", DataType="double")
FOC_LUT_ParkClake_CosLut = Simulink.Parameter([1 0.9999811 0.9999246 0.9998303 0.9996982 0.9995285 0.9993211 0.9990759 0.9987931 0.9984726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 1], StorageClass="ExportedGlobal", DataType="double")
FOC_LUT_DQLimiter_SqrtLutx = Simulink.Parameter([0 0.0009775171 0.001955034 0.002932551 0.003910068 0.004887586 0.005865103 0.00684262 0.007820137 0.008797654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 1], StorageClass="ExportedGlobal", DataType="double")
FOC_LUT_DQLimiter_SqrtLuty = Simulink.Parameter([0 7.220405 10.21119 12.50611 14.44081 16.14532 17.68631 19.1034 20.42239 21.66121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 230.9401], StorageClass="ExportedGlobal", DataType="double")
FOC_LUT_DQLimiter_DQ_LUTScaling = Simulink.Parameter(1.875e-05, StorageClass="ExportedGlobal", DataType="double")
FOC_Control_RF_omegamech_rad_s = Simulink.Parameter(3141.593, StorageClass="ExportedGlobal", DataType="double")
FOC_SampleTime_TsCur = Simulink.Parameter(0.0001, StorageClass="ExportedGlobal", DataType="double")
FOC_Control_theta_mechOffsetFix = Simulink.Parameter(0, StorageClass="ExportedGlobal", DataType="double")
FOC_Control_theta_mechOffsetTime = Simulink.Parameter(0, StorageClass="ExportedGlobal", DataType="double")
FOC_PWM_HybridMode = Simulink.Parameter(1, StorageClass="ExportedGlobal", DataType="uint8")
FOC_PWM_PWMManuel = Simulink.Parameter(1, StorageClass="ExportedGlobal", DataType="uint8")
FOC_PWM_AZSPWMMethod = Simulink.Parameter(3, StorageClass="ExportedGlobal", DataType="uint8")
FOC_PWM_RSPWMMethod = Simulink.Parameter(2, StorageClass="ExportedGlobal", DataType="uint8")
FOC_PWM_LB1 = Simulink.Parameter(0.5, StorageClass="ExportedGlobal", DataType="double")
FOC_PWM_UB1 = Simulink.Parameter(0.66, StorageClass="ExportedGlobal", DataType="double")
FOC_PWM_LB2 = Simulink.Parameter(0.77, StorageClass="ExportedGlobal", DataType="double")
FOC_PWM_UB2 = Simulink.Parameter(0.9, StorageClass="ExportedGlobal", DataType="double")
FOC_LUT_ModIndex_SqrtLutx = Simulink.Parameter([0 0.0009775171 0.001955034 0.002932551 0.003910068 0.004887586 0.005865103 0.00684262 0.007820137 0.008797654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 3], StorageClass="ExportedGlobal", DataType="double")
FOC_LUT_ModIndex_SqrtLuty = Simulink.Parameter([0 0.03126527 0.04421577 0.05415304 0.06253054 0.06991127 0.07658396 0.08272013 0.08843154 0.09379581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 1.732051], StorageClass="ExportedGlobal", DataType="double")
FOC_Flag_SpeedControl = Simulink.Parameter(1, StorageClass="ExportedGlobal", DataType="boolean")
FOC_Plant_Motor_Ld = Simulink.Parameter(6.8402e-5, StorageClass="ExportedGlobal", DataType="double")
FOC_Plant_Motor_Lq = Simulink.Parameter(0.00019656, StorageClass="ExportedGlobal", DataType="double")
FOC_LUT_ParkClake_AtanLut = Simulink.Parameter([0 0.002441329 0.004882192 0.007322124 0.009760662 0.01219734 0.01463171 0.0170633 0.01949166 0.02191634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 0.3677819], StorageClass="ExportedGlobal")
Filter_Current_SensorTimeConst = Simulink.Parameter(1.591549e-06, StorageClass="ExportedGlobal")
Filter_Current_FilterTimeConst = Simulink.Parameter(3.333333e-05, StorageClass="ExportedGlobal")

SdaProblemBus = Simulink.Bus()
  H: double[15 15]
  U_unc: double[15 1]
  NmaxNode: uint32
  UoptPrev: double[15 1]
  iabcCompensated: double[3 1]
  deltaIabcBase: double[3 1]
  deltaIabcSwitch: double[3 3]
  lambdaZero: double
  lambdaDeadtime: double
  deadtimeRatio: double
  currentEpsMargin: double

SdaMemoryBus = Simulink.Bus()
  Uwork: boolean[15 1]
  candidatePosition: uint8[15 1]
  metricStack: double[16 1]
  cmvMetricStack: double[16 1]
  iabcPrediction: double[3 6]
  z: double[15 1]

SdaBestBus = Simulink.Bus()
  bestU: boolean[15 1]
  bestMetric: double
  bestCMVCost: double
  bestValid: boolean

SdaResultBus = Simulink.Bus()
  valid: boolean
  Jopt: double
  nodes: uint32
  optimal: boolean
  Uopt: double[15 1]
  Uapply: double[6 1]
  leafNodes: uint32
  bestCMVCost: double
  cmvMetricRatio: double
  switchCountApplied: uint32
  debugLower: double[3 1]
  debugUpper: double[3 1]
  iabcPredictedNext: double[3 1]
  Jround: double
  Jshift: double
  predictionValidNext: boolean
  solutionToggle: boolean

SdaComparisonResultBus = Simulink.Bus()
  Jopt: double
  nodes: uint32
  optimal: boolean
  Uopt: double[15 1]
  Uapply: double[6 1]
  predictionValidNext: boolean
  iabcPredictedNext: double[3 1]
  leafNodes: uint32
  bestCMVCost: double
  cmvMetricRatio: double
  switchCountApplied: uint32
  debug_lower: double[3 1]
  debug_upper: double[3 1]
  Jround: double
  Jshift: double
  Jbabai: double
  JbabaiExplicit: double
  initialRadius: double
  solutionToggle: boolean

SdaHandshakeBus = Simulink.Bus()
  busy: boolean
  resultValid: boolean
  fault: boolean

SdaDebugBus = Simulink.Bus()
  fsmState: uint8
  level: uint8
  candidate: boolean
  head: double
  center: double
  quadraticMetric: double
  vectorMetric: double
  cycleCount: uint32
  fault: boolean